# Dynamo graph decodes-dynamo.dyn (Dynamo 0.7.0.24809)

code_block = CodeBlock { 7; }
python_script = Python(IN[0]=code_block)
# ---------- python_script.python (23 lines) ----------
# Default imports
#import r'C:\Program Files (x86)\IronPython 2.7\Lib\site-packages\ksteinfe'
import sys
import ksteinfe
import clr

clr.AddReference('ProtoGeometry')
# copy decodes here########################
# C:\Users\cesandoval\Documents\Github\Dynamo\bin\AnyCPU\Debug\Lib\
#from Autodesk.DesignScript.Geometry import *
import Autodesk.DesignScript.Geometry as ds
#The inputs to this node will be stored as a list in the IN variable.
#print 
pt = ds.Point.ByCoordinates(0,0,0)
pt2 = ds.Point.ByCoordinates(10,10,10)
pt3 = ds.Point.ByCoordinates(15,5,25)
vec = ds.Vector.ByCoordinates(0,0,1)
line = ds.Line.ByStartPointEndPoint(pt, pt2)
circle = ds.Circle.ByCenterPointRadiusNormal(pt,3.0,vec)
pline = ds.PolyCurve.ByPoints(tuple([pt,pt2,pt3]),False)
pgon = ds.PolyCurve.ByPoints(tuple([pt,pt2,pt3]),True)
#Assign your output to the OUT variable
OUT = pgon
# ----------------------------------------
watch = Watch(python_script)
