# Dynamo graph decodes-dynamo2.dyn (Dynamo 0.7.0.23565)

code_block = CodeBlock { 1..2; }
python_script = Python(IN[0]=code_block)
# ---------- python_script.python (9 lines) ----------
import clr
clr.AddReference('ProtoGeometry')
from Autodesk.DesignScript.Geometry import *
#The inputs to this node will be stored as a list in the IN variable.
print 555555555555

dataEnteringNode = IN
#Assign your output to the OUT variable
OUT = Point.ByCoordinates(IN[0][0],IN[0][1],0)
# ----------------------------------------
watch = Watch(python_script)
python_script_2 = Python()  # starter script, not edited (OUT = 0)
