# Dynamo graph decodes-dynamo_innie_test.dyn (Dynamo 0.7.0.18982)

code_block = CodeBlock { 7; }
python_script = Python(IN[0]=code_block)
# ---------- python_script.python (32 lines) ----------
# Default imports
#C:\Users\cesandoval\Documents\Github\Dynamo\bin\AnyCPU\Debug\Lib\\ksteinfe'
import sys
sys.path.append('C:/Python27/Lib')
sys.path.append('C:/Users/cesandoval/Documents/Github/decodes')

import clr
from decodes import *
from decodes.core import *

clr.AddReference('ProtoGeometry')
import Autodesk.DesignScript.Geometry as ds

#The inputs to this node will be stored as a list in the IN variable.
pt = ds.Point.ByCoordinates(10,0,0)
pt2 = ds.Point.ByCoordinates(10,10,10)
pt3 = ds.Point.ByCoordinates(15,5,25)
vec = ds.Vector.ByCoordinates(0,0,1)
line = ds.Line.ByStartPointEndPoint(pt, pt2)
circle = ds.Circle.ByCenterPointRadiusNormal(pt,3.0,vec)
arc = ds.Arc.ByCenterPointRadiusAngle(pt,3.0,0,35,vec)
pline = ds.PolyCurve.ByPoints(tuple([pt,pt2,pt3]),False)
pgon = ds.PolyCurve.ByPoints(tuple([pt,pt2,pt3]),True)
crv = ds.NurbsCurve.ByPoints(tuple([pt,pt2,pt3]))
rect = ds.Rectangle.ByWidthHeight(5,4)
pt_test = Point()
#color = ds.Color.ByARGB(0,0,0)
print 'hello world'
print 444444444444444444444444555555555555555555555555555666666666666666

#Assign your output to the OUT variable
OUT = pgon.ContextCoordinateSystem#IN[0]#ds.Point.ByCoordinates(pt_test.x,pt_test.y,pt_test.z)
# ----------------------------------------
watch = Watch(python_script)
code_block_2 = CodeBlock { {1,2}; }
python_script_2 = Python()
# ---------- python_script_2.python (11 lines) ----------
import clr
clr.AddReference('ProtoGeometry')
from Autodesk.DesignScript.Geometry import *
#The inputs to this node will be stored as a list in the IN variable.
dataEnteringNode = IN
import sys
sys.path.append('C:/Python27/Lib')
import random

#Assign your output to the OUT variable
OUT = random.randint(0,5)
# ----------------------------------------
python_script_3 = Python(IN[0]=code_block)
# ---------- python_script_3.python (58 lines) ----------
# Default imports
#C:\Users\cesandoval\Documents\Github\Dynamo\bin\AnyCPU\Debug\Lib\\ksteinfe'
import sys
sys.path.append('C:/Python27/Lib')
sys.path.append('C:/Users/cesandoval/Documents/Github/decodes')

import clr
from decodes import *
from decodes.core import *

clr.AddReference('ProtoGeometry')
import Autodesk.DesignScript.Geometry as ds

#The inputs to this node will be stored as a list in the IN variable.
verts = ( ds.Point.ByCoordinates(9.0, 0.5, 0.0), ds.Point.ByCoordinates(9.1, 1.2143, 0.0), ds.Point.ByCoordinates(9.2, 1.9286, 0.0),
    ds.Point.ByCoordinates(9.3, 2.6429, 0.0), ds.Point.ByCoordinates(9.4, 3.3571, 0.0), ds.Point.ByCoordinates(9.5, 4.0714, 0.0),
    ds.Point.ByCoordinates(9.6, 4.7857, 0.0), ds.Point.ByCoordinates(9.7, 5.5, 0.0), ds.Point.ByCoordinates(10.0714, 0.2286, 0.0),
    ds.Point.ByCoordinates(10.1612, 1.0, 0.0), ds.Point.ByCoordinates(10.251, 1.7714, 0.0), ds.Point.ByCoordinates(10.3408, 2.5429, 0.0),
    ds.Point.ByCoordinates(10.4306, 3.3143, 0.0), ds.Point.ByCoordinates(10.5204, 4.0857, 0.0), ds.Point.ByCoordinates(10.6102, 4.8571, 0.0),
    ds.Point.ByCoordinates(10.7, 5.6286, 0.0), ds.Point.ByCoordinates(11.1429, -0.0429, 0.0), ds.Point.ByCoordinates(11.2224, 0.7857, 0.0),
    ds.Point.ByCoordinates(11.5408, 4.1, 0.0), ds.Point.ByCoordinates(11.6204, 4.9286, 0.0), ds.Point.ByCoordinates(11.7, 5.7571, 0.0),
    ds.Point.ByCoordinates(12.2143, -0.3143, 0.0), ds.Point.ByCoordinates(12.2837, 0.5714, 0.0), ds.Point.ByCoordinates(12.5612, 4.1143, 0.0),
    ds.Point.ByCoordinates(12.6306, 5.0, 0.0), ds.Point.ByCoordinates(12.7, 5.8857, 0.0), ds.Point.ByCoordinates(13.2857, -0.5857, 0.0),
    ds.Point.ByCoordinates(13.3449, 0.3571, 0.0), ds.Point.ByCoordinates(13.5816, 4.1286, 0.0), ds.Point.ByCoordinates(13.6408, 5.0714, 0.0),
    ds.Point.ByCoordinates(13.7, 6.0143, 0.0), ds.Point.ByCoordinates(14.3571, -0.8571, 0.0), ds.Point.ByCoordinates(14.4061, 0.1429, 0.0),
    ds.Point.ByCoordinates(14.4551, 1.1429, 0.0), ds.Point.ByCoordinates(14.5041, 2.1429, 0.0), ds.Point.ByCoordinates(14.5531, 3.1429, 0.0),
    ds.Point.ByCoordinates(14.602, 4.1429, 0.0), ds.Point.ByCoordinates(14.651, 5.1429, 0.0), ds.Point.ByCoordinates(14.7, 6.1429, 0.0),
    ds.Point.ByCoordinates(15.4286, -1.1286, 0.0), ds.Point.ByCoordinates(15.4673, -0.0714, 0.0), ds.Point.ByCoordinates(15.5061, 0.9857, 0.0),
    ds.Point.ByCoordinates(15.5449, 2.0429, 0.0), ds.Point.ByCoordinates(15.5837, 3.1, 0.0), ds.Point.ByCoordinates(15.6224, 4.1571, 0.0),
    ds.Point.ByCoordinates(15.6612, 5.2143, 0.0), ds.Point.ByCoordinates(15.7, 6.2714, 0.0), ds.Point.ByCoordinates(16.5, -1.4, 0.0),
    ds.Point.ByCoordinates(16.5286, -0.2857, 0.0), ds.Point.ByCoordinates(16.5571, 0.8286, 0.0), ds.Point.ByCoordinates(16.5857, 1.9429, 0.0),
    ds.Point.ByCoordinates(16.6143, 3.0571, 0.0), ds.Point.ByCoordinates(16.6429, 4.1714, 0.0), ds.Point.ByCoordinates(16.6714, 5.2857, 0.0),
    ds.Point.ByCoordinates(16.7, 6.4, 0.0), ds.Point.ByCoordinates(10.5, 1.5, 0.0), ds.Point.ByCoordinates(10.8, 2.1667, 0.0),
    ds.Point.ByCoordinates(11.1, 2.8333, 0.0), ds.Point.ByCoordinates(11.4, 3.5, 0.0), ds.Point.ByCoordinates(12.0667, 3.5667, 0.0),
    ds.Point.ByCoordinates(12.7333, 3.6333, 0.0), ds.Point.ByCoordinates(13.4, 3.7, 0.0), ds.Point.ByCoordinates(13.6, 3.0, 0.0),
    ds.Point.ByCoordinates(13.8, 2.3, 0.0), ds.Point.ByCoordinates(14.0, 1.6, 0.0), ds.Point.ByCoordinates(14.2, 0.9, 0.0),
    ds.Point.ByCoordinates(13.46, 1.02, 0.0), ds.Point.ByCoordinates(12.72, 1.14, 0.0), ds.Point.ByCoordinates(11.98, 1.26, 0.0), ds.Point.ByCoordinates(11.24, 1.38, 0.0) )

faces = ( ( 9, 1, 0 ), ( 10, 2, 1 ), ( 11, 3, 10 ), ( 12, 4, 11 ), ( 13, 5, 12 ), ( 14, 6, 13 ), ( 15, 7, 14 ), ( 17, 9, 8 ), ( 19, 14, 18 ), ( 20, 15, 19 ),
    ( 22, 17, 16 ), ( 24, 19, 23 ), ( 25, 20, 24 ), ( 27, 22, 21 ), ( 29, 24, 28 ), ( 30, 25, 29 ), ( 32, 27, 26 ), ( 37, 29, 36 ), ( 38, 30, 37 ), ( 40, 32, 31 ),
    ( 42, 34, 33 ), ( 43, 35, 34 ), ( 44, 36, 43 ), ( 45, 37, 44 ), ( 46, 38, 45 ), ( 48, 40, 39 ), ( 49, 41, 40 ), ( 50, 42, 41 ), ( 51, 43, 42 ), ( 52, 44, 51 ),
    ( 53, 45, 52 ), ( 54, 46, 53 ), ( 10, 9, 55 ), ( 17, 55, 9 ), ( 11, 10, 56 ), ( 55, 56, 10 ), ( 68, 17, 22 ), ( 17, 68, 69 ), ( 55, 17, 69 ), ( 12, 11, 57 ),
    ( 56, 57, 11 ), ( 12, 58, 13 ), ( 58, 12, 57 ), ( 18, 58, 59 ), ( 59, 23, 18 ), ( 60, 23, 59 ), ( 13, 58, 18 ), ( 67, 68, 22 ), ( 66, 67, 27 ), ( 22, 27, 67 ),
    ( 27, 65, 66 ), ( 65, 27, 32 ), ( 40, 41, 32 ), ( 65, 32, 33 ), ( 65, 33, 64 ), ( 61, 28, 23 ), ( 61, 36, 28 ), ( 35, 61, 62 ), ( 60, 61, 23 ), ( 63, 64, 34 ),
    ( 33, 34, 64 ), ( 61, 35, 36 ), ( 34, 35, 63 ), ( 63, 35, 62 ), ( 9, 0, 8 ), ( 10, 1, 9 ), ( 3, 2, 10 ), ( 4, 3, 11 ), ( 5, 4, 12 ), ( 6, 5, 13 ), ( 7, 6, 14 ),
    ( 17, 8, 16 ), ( 14, 13, 18 ), ( 15, 14, 19 ), ( 22, 16, 21 ), ( 19, 18, 23 ), ( 20, 19, 24 ), ( 27, 21, 26 ), ( 24, 23, 28 ), ( 25, 24, 29 ), ( 32, 26, 31 ),
    ( 29, 28, 36 ), ( 30, 29, 37 ), ( 40, 31, 39 ), ( 42, 33, 41 ), ( 43, 34, 42 ), ( 36, 35, 43 ), ( 37, 36, 44 ), ( 38, 37, 45 ), ( 48, 39, 47 ), ( 49, 40, 48 ),
    ( 50, 41, 49 ), ( 51, 42, 50 ), ( 44, 43, 51 ), ( 45, 44, 52 ), ( 46, 45, 53 ), ( 41, 33, 32 ) )

group = []
for face in faces:
	group.append(ds.IndexGroup.ByIndices(face[0],face[1],face[2]))
group = tuple(group)
msh = ds.Mesh.ByPointsFaceIndices(verts, group)
new_verts = msh.VertexPositions
new_faces = msh.FaceIndices
#Assign your output to the OUT variable
OUT = new_faces[0]#pgon.ContextCoordinateSystem#IN[0]#ds.Point.ByCoordinates(pt_test.x,pt_test.y,pt_test.z)
# ----------------------------------------
watch_2 = Watch(python_script_3)
code_block_3 = CodeBlock { "bool", "int", "float", "str"; }
boolean = BoolSelector(false)
code_block_4 = CodeBlock { 5.45; }
code_block_5 = CodeBlock { 5; }
toString = ToString(code_block_5)
python_script_4 = Python(IN[0]=toString)
# ---------- python_script_4.python (15 lines) ----------
# Default imports
#C:\Users\cesandoval\Documents\Github\Dynamo\bin\AnyCPU\Debug\Lib\\ksteinfe'
import sys
sys.path.append('C:/Python27/Lib')
sys.path.append('C:/Users/cesandoval/Documents/Github/decodes')

import clr
from decodes import *
from decodes.core import *

clr.AddReference('ProtoGeometry')
import Autodesk.DesignScript.Geometry as ds

#Assign your output to the OUT variable
OUT = str(type(IN[0]))#pgon.ContextCoordinateSystem#IN[0]#ds.Point.ByCoordinates(pt_test.x,pt_test.y,pt_test.z)
# ----------------------------------------
watch_3 = Watch(python_script_4)
code_block_6 = CodeBlock { 5; }
a = Point.ByCoordinates(code_block_6, code_block_6)
byCenterPointRadius = Circle.ByCenterPointRadius(a, code_block_6)
identity = CoordinateSystem.Identity()
code_block_7 = CodeBlock { 3.2; }
byCoordinateSystemRadii = Ellipse.ByCoordinateSystemRadii(identity, code_block_7, code_block_6)
b = CoordinateSystem.Origin(identity)
byStartPointEndPoint = Line.ByStartPointEndPoint(a, b)
byPointsFaceIndices = Mesh.ByPointsFaceIndices()
ZAxis = Vector.ZAxis()
byOriginNormal = Plane.ByOriginNormal(a, ZAxis)
byPoints = PolyCurve.ByPoints()
byPoints_2 = Polygon.ByPoints()
byWidthHeight = Rectangle.ByWidthHeight(identity, code_block_7, code_block_6)
byCoordinates = Vector.ByCoordinates()
code_block_8 = CodeBlock { 0; }
code_block_9 = CodeBlock { 95; }
byCenterPointRadiusAngle = Arc.ByCenterPointRadiusAngle(a, code_block_7, code_block_8, code_block_9, ZAxis)
byCoordinates_2 = Point.ByCoordinates(code_block_7, code_block_7)
c = Geometry.Translate(byCoordinates_2, ZAxis)
code_block_10 = CodeBlock(a=a, c=c, b=b) { {a,c,b}; }
byPoints_3 = NurbsCurve.ByPoints(code_block_10)
