# Dynamo graph decodes-dynamo_innie_test2.dyn (Dynamo 0.7.0.26254)

code_block = CodeBlock { {1,2}; }
boolean = BoolSelector(false)
code_block_2 = CodeBlock { 5.45; }
code_block_3 = CodeBlock { 5; }
toString = ToString(code_block_3)
watch = Watch()
code_block_4 = CodeBlock { 5; }
byCoordinates = Point.ByCoordinates(code_block_4, code_block_4)
byCenterPointRadius = Circle.ByCenterPointRadius(byCoordinates, code_block_4)
identity = CoordinateSystem.Identity()
code_block_5 = CodeBlock { 3.2; }
byCoordinateSystemRadii = Ellipse.ByCoordinateSystemRadii(identity, code_block_5, code_block_4)
origin = CoordinateSystem.Origin(identity)
byStartPointEndPoint = Line.ByStartPointEndPoint(byCoordinates, origin)
byPointsFaceIndices = Mesh.ByPointsFaceIndices()
ZAxis = Vector.ZAxis()
byOriginNormal = Plane.ByOriginNormal(byCoordinates, ZAxis)
byPoints = PolyCurve.ByPoints()
byPoints_2 = Polygon.ByPoints()
byWidthHeight = Rectangle.ByWidthHeight(identity, code_block_5, code_block_4)
byCoordinates_2 = Vector.ByCoordinates()
code_block_6 = CodeBlock { 0; }
code_block_7 = CodeBlock { 95; }
byCenterPointRadiusAngle = Arc.ByCenterPointRadiusAngle(byCoordinates, code_block_5, code_block_6, code_block_7, ZAxis)
byCoordinates_3 = Point.ByCoordinates(code_block_5, code_block_5)
translate = Geometry.Translate(byCoordinates_3, ZAxis)
code_block_8 = CodeBlock(a=byCoordinates, c=translate, b=origin) { {a,c,b}; }
byPoints_3 = NurbsCurve.ByPoints(code_block_8)
code_block_9 = CodeBlock { 7; }
python_script = Python(IN[0]=code_block_9)
# ---------- python_script.python (23 lines) ----------
# Default imports
#C:\Users\cesandoval\Documents\Github\Dynamo\bin\AnyCPU\Debug\Lib\\ksteinfe'
import sys
sys.path.append('C:/Python27/Lib')
sys.path.append('C:/Users/cesandoval/Documents/Github/decodes')
sys.path.append('C:/Program Files (x86)/Rhinoceros 5/Plug-ins/IronPython/Lib')
sys.path.append('C:/Users/cesandoval/AppData/Roaming/McNeel/Rhinoceros/5.0/Plug-ins/IronPython (814d908a-e25c-493d-97e9-ee3861957f49)/settings/lib')

import clr
from decodes import *
from decodes.io.dynamo_in import *
from decodes.core import *

clr.AddReference('ProtoGeometry')
import Autodesk.DesignScript.Geometry as ds

if isinstance(IN[0], list):
	for input in IN[0] : 
	        test = DynamoIn.get(input)
else:
	test = DynamoIn.get(input)
#Assign your output to the OUT variable
OUT = test#pgon.ContextCoordinateSystem#IN[0]#ds.Point.ByCoordinates(pt_test.x,pt_test.y,pt_test.z)
# ----------------------------------------
