# Dynamo graph decodes-dynamo_innie_test3.dyn (Dynamo 0.7.0.19329)

code_block = CodeBlock { 7; }
code_block_2 = CodeBlock { {1,2}; }
code_block_3 = CodeBlock { 5.45; }
code_block_4 = CodeBlock { 5; }
byCoordinates = Point.ByCoordinates(code_block_4, code_block_4)
byCenterPointRadius = Circle.ByCenterPointRadius(byCoordinates, code_block_4)
identity = CoordinateSystem.Identity()
code_block_5 = CodeBlock { 3.2; }
byCoordinateSystemRadii = Ellipse.ByCoordinateSystemRadii(identity, code_block_5, code_block_4)
origin = CoordinateSystem.Origin(identity)
byStartPointEndPoint = Line.ByStartPointEndPoint(byCoordinates, origin)
byPointsFaceIndices = Mesh.ByPointsFaceIndices()
ZAxis = Vector.ZAxis()
byOriginNormal = Plane.ByOriginNormal(byCoordinates, ZAxis)
byCoordinates_2 = Point.ByCoordinates(code_block_5, code_block_5)
translate = Geometry.Translate(byCoordinates_2, ZAxis)
code_block_6 = CodeBlock(a=byCoordinates, c=translate, b=origin) { {a,c,b}; }
boolean = BoolSelector(false)
byPoints = PolyCurve.ByPoints(code_block_6, boolean)
byPoints_2 = Polygon.ByPoints(code_block_6)
byWidthHeight = Rectangle.ByWidthHeight(identity, code_block_5, code_block_4)
code_block_7 = CodeBlock { 0; }
byCoordinates_3 = Vector.ByCoordinates(code_block_7, code_block_4, code_block_4)
code_block_8 = CodeBlock { 95; }
byCenterPointRadiusAngle = Arc.ByCenterPointRadiusAngle(byCoordinates, code_block_5, code_block_7, code_block_8, ZAxis)
code_block_9 = CodeBlock { 5; }
toString = ToString(code_block_9)
python_script = Python(IN[0]=toString)
# ---------- python_script.python (17 lines) ----------
import sys
sys.path.append('C:/Python27/Lib')
sys.path.append('C:/Users/cesandoval/Documents/Github/decodes')

## -- BEGIN DECODES HEADER -- ##
import decodes as dc
from decodes.core import *
from decodes.io.dynamo_in import *
from decodes.io.dynamo_out import *
exec(io.dynamo_in.component_header_code)
exec(io.dynamo_out.component_header_code)
## -- END DECODES HEADER -- ##
out.put([[Point(), Point(2)],Point(5),[Point(3,3,3),Point(1,1,1)]])
## -- BEGIN DECODES FOOTER -- ##
exec(io.dynamo_out.component_footer_code)
## -- END DECODES FOOTER -- ##
#########kkkkkkk
# ----------------------------------------
watch = Watch(python_script)
byPoints_3 = NurbsCurve.ByPoints(code_block_6)
python_script_2 = Python(IN[0]=byPoints_3)
# ---------- python_script_2.python (16 lines) ----------
import sys
sys.path.append('C:/Python27/Lib')
sys.path.append('C:/Users/cesandoval/Documents/Github/decodes')

## -- BEGIN DECODES HEADER -- ##
import decodes as dc
from decodes.core import *
from decodes.io.dynamo_in import *
from decodes.io.dynamo_out import *
exec(io.dynamo_in.component_header_code)
exec(io.dynamo_out.component_header_code)
## -- END DECODES HEADER -- ##
out.put(IN[0])
exec(io.dynamo_out.component_footer_code)
## -- END DECODES FOOTER -- ##
###################5555444jjjiiiiioioigggg5555554353488787
# ----------------------------------------
watch_2 = Watch(python_script_2)
code_block_10 = CodeBlock()
# ---------- code_block_10.designscript (14 lines) ----------
p1 = Point.ByCoordinates(1.0221, 3.3941, 0.0);
p2 = Point.ByCoordinates(-0.0497, 3.4856, 0.0);
p3 = Point.ByCoordinates(2.0546, 3.4464, 0.0);
p4 = Point.ByCoordinates(-0.0084, -0.0004, 0.0);
p5 = Point.ByCoordinates(-0.0169, 1.8605, 0.0);
p6 = Point.ByCoordinates(1.0121, -0.0004, 0.0);
p7 = Point.ByCoordinates(2.0154, -0.009, 0.0);
p8 = Point.ByCoordinates(2.024, 1.8176, 0.0);
p9 = Point.ByCoordinates(1.4066, 1.0458, 0.0);

// create the original mesh
verts = { p1, p2, p3, p4, p5, p6, p7, p8, p9 };
faces = { { 4, 8, 0, 1 }, { 8, 7, 2, 0 }, { 3, 5, 8, 4 }, { 5, 6, 7, 8 } };
msh = Mesh.ByVerticesFaceIndices(verts, faces).SetVisibility(false);
# ----------------------------------------
integer_slider = IntegerSlider(10, range=0..100)
python_script_3 = Python(IN[0]=integer_slider)
# ---------- python_script_3.python (35 lines) ----------
import sys
sys.path.append('C:/Python27/Lib')
sys.path.append('C:/Users/cesandoval/Documents/Github/decodes')

## -- BEGIN DECODES HEADER -- ##
import decodes as dc
from decodes.core import *
from decodes.io.dynamo_in import *
from decodes.io.dynamo_out import *
exec(io.dynamo_in.component_header_code)
exec(io.dynamo_out.component_header_code)
## -- END DECODES HEADER -- ##

def color_point(r_val,g_val,b_val):
    res = Point(r_val,g_val,b_val)
    res.set_color(r_val,g_val,b_val)
    return res


# create an interval with n steps
color_interval = Interval(0.0,1.0).divide(IN[0])

# cycle through each point in the color space 
pts=[]
for ri in color_interval:
    for gi in color_interval:
        for bi in color_interval:
            pt_add = color_point(ri,gi,bi)
            pt_add.set_weight(20.0)
            pts.append(pt_add)

out.put(pts)
exec(io.dynamo_out.component_footer_code)
## -- END DECODES FOOTER -- ##
###################5555444jjjiiiiioioigggg5555554353488787
# ----------------------------------------
watch_3 = Watch(python_script_3)
