# Dynamo graph 4.02.L04.dyn (Dynamo 0.7.0.18805)

decodes_script = Python()
# ---------- decodes_script.python (54 lines) ----------
import clr, sys
clr.AddReference('ProtoGeometry')
clr.AddReference('DSCoreNodes')
from Autodesk.DesignScript.Geometry import *
import DSCore
## -- BEGIN DECODES HEADER -- ##
sys.path.append('C:/Python27/Lib')
import os
if os.path.isdir('C:/Autodesk/Dynamo07/Core/decodes'): sys.path.append('C:/Autodesk/Dynamo07/Core')
#sys.path.append('C:/Users/cesandoval/Documents/Github/decodes')
from decodes.core import *
from decodes.io.dynamo_in import *
from decodes.io.dynamo_out import *
exec(io.dynamo_in.component_header_code)
exec(io.dynamo_out.component_header_code)
## -- END DECODES HEADER -- ##

'''
4.02.L04a
Create a simple Guy class

members:
pos (Point) The location of the Guy object
vel (Vec) The velocity vector of the Guy object

methods:
step (None) Update Guys position and choose a new direction velocity vector
'''
"""
A guy class is defined with a position, direction and a method for updating.
"""

class Guy():
    
    def __init__(self, pos_start = Point(0,0), vel_start = Vec(-0.1,0.1)):    
        # sets the initial position of the Guy
        self.pos = pos_start        
        # sets the initial velocity vector for the Guy
        self.vel = vel_start
        
    """
    Cause the Guy object to move, using its current velocity, then randomly pick a new velocity 
    """       
    def step(self):        
        # update the position of the Guy
        self.pos += self.vel       
        # pick a new 2d velocity vector
        self.vel = Vec.random(Interval(-1,1,),constrain2d = True)        

out.put(Guy)

## -- BEGIN DECODES FOOTER -- ##
exec(io.dynamo_out.component_footer_code)
## -- END DECODES FOOTER -- ##
# ----------------------------------------
double_slider = DoubleSlider(-2.674, range=-10..10)
double_slider_2 = DoubleSlider(-1.675, range=-10..10)
code_block = CodeBlock { 0; }
byCoordinates = Point.ByCoordinates(double_slider, double_slider_2, code_block)
double_slider_3 = DoubleSlider(0.59, range=-10..10)
double_slider_4 = DoubleSlider(0.21, range=-10..10)
code_block_2 = CodeBlock { 0; }
byCoordinates_2 = Point.ByCoordinates(double_slider_3, double_slider_4, code_block_2)
integer_slider = IntegerSlider(45, range=0..100)
decodes_script_2 = Python(IN[0]=decodes_script, IN[1]=byCoordinates, IN[2]=byCoordinates_2, IN[3]=integer_slider)
# ---------- decodes_script_2.python (42 lines) ----------
import clr, sys
clr.AddReference('ProtoGeometry')
clr.AddReference('DSCoreNodes')
from Autodesk.DesignScript.Geometry import *
import DSCore
## -- BEGIN DECODES HEADER -- ##
sys.path.append('C:/Python27/Lib')
import os
if os.path.isdir('C:/Autodesk/Dynamo07/Core/decodes'): sys.path.append('C:/Autodesk/Dynamo07/Core')
#sys.path.append('C:/Users/cesandoval/Documents/Github/decodes')
from decodes.core import *
from decodes.io.dynamo_in import *
from decodes.io.dynamo_out import *
exec(io.dynamo_in.component_header_code)
exec(io.dynamo_out.component_header_code)
## -- END DECODES HEADER -- ##
random.seed(.5) # initialize the random number seed#########

"""
Create a Guy, let it wander, then show its path.
"""

# initialize an instance of the Guy class
debord = IN[0][0](IN[1],IN[2])
# initialize the path
path_pts = []

# for every time step:
for n in range(IN[3]):
    # record the Guy's position
    path_pts.append(debord.pos)
    # update the Guy's position and velocity
    debord.step()

# make a path from the points
path_line = PLine(path_pts)

out.put(path_line)

## -- BEGIN DECODES FOOTER -- ##
exec(io.dynamo_out.component_footer_code)
## -- END DECODES FOOTER -- ##
# ----------------------------------------
watch_3d = Watch3D(decodes_script_2)
decodes_script_3 = Python()
# ---------- decodes_script_3.python (65 lines) ----------
import clr, sys
clr.AddReference('ProtoGeometry')
clr.AddReference('DSCoreNodes')
from Autodesk.DesignScript.Geometry import *
import DSCore
## -- BEGIN DECODES HEADER -- ##
sys.path.append('C:/Python27/Lib')
import os
if os.path.isdir('C:/Autodesk/Dynamo07/Core/decodes'): sys.path.append('C:/Autodesk/Dynamo07/Core')
#sys.path.append('C:/Users/cesandoval/Documents/Github/decodes')
from decodes.core import *
from decodes.io.dynamo_in import *
from decodes.io.dynamo_out import *
exec(io.dynamo_in.component_header_code)
exec(io.dynamo_out.component_header_code)
## -- END DECODES HEADER -- ##

'''
4.02.L04c
Create a new Guy class that can be steered

members:
pos (Point) The location of the Guy object
vel (Vec) The velocity vector of the Guy object

methods:
step (None) Update Guys position and choose a new direction velocity vector
steer (Vec) Modify Guy's velocity by a given vector
'''
"""
A guy class is defined with a position, direction and a method for updating.
"""

class Guy():
    
    def __init__(self, pos_start = Point(0,0), vel_start = Vec(-0.1,0.1)):   
        # sets the initial position of the Guy
        self.pos = pos_start        
        # sets the initial velocity vector for the Guy
        self.vel = vel_start
        
    """
    Cause the Guy object to move, using its current velocity, then randomly
    pick a new velocity 
    """       
    def step(self):        
        # update the position of the Guy
        self.pos += self.vel        
        # pick a new 2d velocity vector
        self.vel = Vec.random(Interval(-1,1,),constrain2d = True)        
        
    """
    Steer the Guy by adding a given vector to its current velocity
    """           
    def steer(self, vec):
        # limit to the force of the vector
        vec = vec.limited(.5)        
        # update the velocity of the Guy
        self.vel += vec    

out.put(Guy)

## -- BEGIN DECODES FOOTER -- ##
exec(io.dynamo_out.component_footer_code)
## -- END DECODES FOOTER -- ##
# ----------------------------------------
double_slider_5 = DoubleSlider(-2.674, range=-10..10)
double_slider_6 = DoubleSlider(-1.675, range=-10..10)
code_block_3 = CodeBlock { 0; }
byCoordinates_3 = Point.ByCoordinates(double_slider_5, double_slider_6, code_block_3)
double_slider_7 = DoubleSlider(0.59, range=-10..10)
double_slider_8 = DoubleSlider(0.21, range=-10..10)
code_block_4 = CodeBlock { 0; }
byCoordinates_4 = Point.ByCoordinates(double_slider_7, double_slider_8, code_block_4)
double_slider_9 = DoubleSlider(11.94, range=-10..20)
double_slider_10 = DoubleSlider(0.52, range=-10..10)
code_block_5 = CodeBlock { 0; }
byCoordinates_5 = Point.ByCoordinates(double_slider_9, double_slider_10, code_block_5)
decodes_script_4 = Python(IN[0]=byCoordinates_5)
# ---------- decodes_script_4.python (39 lines) ----------
import clr, sys
clr.AddReference('ProtoGeometry')
clr.AddReference('DSCoreNodes')
from Autodesk.DesignScript.Geometry import *
import DSCore
## -- BEGIN DECODES HEADER -- ##
sys.path.append('C:/Python27/Lib')
import os
if os.path.isdir('C:/Autodesk/Dynamo07/Core/decodes'): sys.path.append('C:/Autodesk/Dynamo07/Core')
#sys.path.append('C:/Users/cesandoval/Documents/Github/decodes')
from decodes.core import *
from decodes.io.dynamo_in import *
from decodes.io.dynamo_out import *
exec(io.dynamo_in.component_header_code)
exec(io.dynamo_out.component_header_code)
## -- END DECODES HEADER -- ##

"""
Create a vector field and perturb it
"""

# initialize starting locations
start_point = Point(0,0) # set the starting point

# create an instance of a vector field
pixel_res = Interval(10,10) # set the resolution of the vector field
spatial_dim = Interval(50,50) # set the dimension of the vector field
spatial_origin = start_point # center vector field on Guy's start position
vf = VecField(pixel_res, spatial_origin, spatial_dim) # create vector field

# initialize vector field
vf.spin_pt(IN[0])
        
out.put(vf)


## -- BEGIN DECODES FOOTER -- ##
exec(io.dynamo_out.component_footer_code)
## -- END DECODES FOOTER -- ##
# ----------------------------------------
integer_slider_2 = IntegerSlider(45, range=0..100)
decodes_script_5 = Python(IN[0]=decodes_script_3, IN[1]=byCoordinates_3, IN[2]=byCoordinates_4, IN[3]=decodes_script_4, IN[4]=integer_slider_2)
# ---------- decodes_script_5.python (66 lines) ----------
import clr, sys
clr.AddReference('ProtoGeometry')
clr.AddReference('DSCoreNodes')
from Autodesk.DesignScript.Geometry import *
import DSCore
## -- BEGIN DECODES HEADER -- ##
sys.path.append('C:/Python27/Lib')
import os
if os.path.isdir('C:/Autodesk/Dynamo07/Core/decodes'): sys.path.append('C:/Autodesk/Dynamo07/Core')
#sys.path.append('C:/Users/cesandoval/Documents/Github/decodes')
from decodes.core import *
from decodes.io.dynamo_in import *
from decodes.io.dynamo_out import *
exec(io.dynamo_in.component_header_code)
exec(io.dynamo_out.component_header_code)
## -- END DECODES HEADER -- ##
random.seed(0) # initialize the random number seed


'''
4.02.L04d
Have guy respond to a vector field 

required:
start_pt (Point) Initial point of the wandering Guy
start_vel (Vec) Initial velocity of the the wandering Guy
count (int) Amount of time for Guy to wander
vf (VecField) A vector field for guy to wander in


out:
path_pts (list of Points) Guy's locations
path_line (PLine) Guy's path

'''
"""
Create a Guy, let it wander around a vector field, then show its path.
"""

# initialize an instance of the Guy class
debord = IN[0][0](IN[1],IN[2])
# initialize the path
path_pts = []


# for every time step:
for n in range(IN[4]):
    # find vector nearest to the current position
    fvec = IN[3][0].vec_near(debord.pos)    
    # steer the guy
    debord.steer(fvec)   
    # update the guy's position
    debord.step()   
    # record the guy's position
    path_pts.append(debord.pos)

# create a path representing the guy's journey
path_line = PLine(path_pts)


out.put(path_line)


## -- BEGIN DECODES FOOTER -- ##
exec(io.dynamo_out.component_footer_code)
## -- END DECODES FOOTER -- ##
# ----------------------------------------
watch_3d_2 = Watch3D(decodes_script_5)
decodes_script_6 = Python()
# ---------- decodes_script_6.python (81 lines) ----------
import clr, sys
clr.AddReference('ProtoGeometry')
clr.AddReference('DSCoreNodes')
from Autodesk.DesignScript.Geometry import *
import DSCore
## -- BEGIN DECODES HEADER -- ##
sys.path.append('C:/Python27/Lib')
import os
if os.path.isdir('C:/Autodesk/Dynamo07/Core/decodes'): sys.path.append('C:/Autodesk/Dynamo07/Core')
#sys.path.append('C:/Users/cesandoval/Documents/Github/decodes')
from decodes.core import *
from decodes.io.dynamo_in import *
from decodes.io.dynamo_out import *
exec(io.dynamo_in.component_header_code)
exec(io.dynamo_out.component_header_code)
## -- END DECODES HEADER -- ##
'''
4.02.L04e
Create a new Guy class that can be steered

members:
pos (Point) The location of the Guy object
vel (Vec) The velocity vector of the Guy object
hist (list of Point) Previous positions for Guy

methods:
step (None) Update Guys position
steer (Vec) Modify Guy's velocity by a given vector and a random direction
record (None) Record the Guy's position
'''
"""
A guy class is defined with a position, direction and a method for updating.
"""

class Guy():
    
    def __init__(self, pos_start = Point(), vel_start = Vec(-.1,.1)):  
        # sets the initial position of the Guy
        self.pos = pos_start         
        # sets the initial velocity vector for the Guy
        self.vel = vel_start       
        # initialize the history of the Guy with its start position
        self.hist = [pos_start]       
        
    """
    Cause the Guy object to move, using its current velocity, then randomly
    pick a new velocity 
    """       
    def step(self):    
        # limit to a maximum speed this guy can walk
        self.vel = self.vel.limited(.5)        
        # update the position of the Guy
        self.pos += self.vel  
        # record the step (note that we record after moving)
        self.record()  
        
    """
    Steer the Guy by adding a given vector with a random influnence to its current velocity
    """           
    def steer(self, vec, influence = 1.0):
        # limit to the force of the vector
        vec = vec.limited(.5)
        # create a random vector
        ran_vec = Vec.random(Interval(-1,1,),constrain2d = True) 
        # update the velocity of the Guy
        ran_vec *= influence
        self.vel += vec + ran_vec 
        
    """
    Record the current state of the Guy
    """     
    def record(self):
        # append the Guy's position to the history list
        self.hist.append(self.pos)
        
        
out.put(Guy)

## -- BEGIN DECODES FOOTER -- ##
exec(io.dynamo_out.component_footer_code)
## -- END DECODES FOOTER -- ##
# ----------------------------------------
decodes_script_7 = Python(IN[0]=decodes_script_6)
# ---------- decodes_script_7.python (36 lines) ----------
import clr, sys
clr.AddReference('ProtoGeometry')
clr.AddReference('DSCoreNodes')
from Autodesk.DesignScript.Geometry import *
import DSCore
## -- BEGIN DECODES HEADER -- ##
sys.path.append('C:/Python27/Lib')
import os
if os.path.isdir('C:/Autodesk/Dynamo07/Core/decodes'): sys.path.append('C:/Autodesk/Dynamo07/Core')
#sys.path.append('C:/Users/cesandoval/Documents/Github/decodes')
from decodes.core import *
from decodes.io.dynamo_in import *
from decodes.io.dynamo_out import *
exec(io.dynamo_in.component_header_code)
exec(io.dynamo_out.component_header_code)
## -- END DECODES HEADER -- ##

"""
Create a new Jorn class from the Guy class by altering the steer method
"""     
class Jorn(IN[0][0]):
    def steer(self, vec, influence = 1.0):
        # limit to the force of the vector (GH EXAMPLE HAS .1)
        vec = vec.limited(.5)
        # create a random vector
        ran_vec = Vec.random(Interval(-1,1,),constrain2d = True) 
        # update the velocity of the Guy
        ran_vec *= influence
        self.vel -= (vec - ran_vec) 

out.put(Jorn)


## -- BEGIN DECODES FOOTER -- ##
exec(io.dynamo_out.component_footer_code)
## -- END DECODES FOOTER -- ##
# ----------------------------------------
integer_slider_3 = IntegerSlider(45, range=0..100)
double_slider_11 = DoubleSlider(0.18, range=-10..10)
integer_slider_4 = IntegerSlider(45, range=0..100)
decodes_script_8 = Python(IN[0]=decodes_script_6, IN[1]=decodes_script_7, IN[2]=decodes_script_4, IN[3]=integer_slider_3, IN[4]=double_slider_11, IN[5]=integer_slider_4)
# ---------- decodes_script_8.python (79 lines) ----------
import clr, sys
clr.AddReference('ProtoGeometry')
clr.AddReference('DSCoreNodes')
from Autodesk.DesignScript.Geometry import *
import DSCore
## -- BEGIN DECODES HEADER -- ##
sys.path.append('C:/Python27/Lib')
import os
if os.path.isdir('C:/Autodesk/Dynamo07/Core/decodes'): sys.path.append('C:/Autodesk/Dynamo07/Core')
#sys.path.append('C:/Users/cesandoval/Documents/Github/decodes')
from decodes.core import *
from decodes.io.dynamo_in import *
from decodes.io.dynamo_out import *
exec(io.dynamo_in.component_header_code)
exec(io.dynamo_out.component_header_code)
## -- END DECODES HEADER -- ##
random.seed(0)

'''
4.02.L04f
Make multiple walkers or different types and demonstrate their behavior.

required: 
Guy (class) A class of walker
Jorn (Guy) A class of walker based on Guy
max_walkers (int) The maximum number of walkers
vf (VecField) A vector field for walkers to wander in
influence (float) The amount of randomness in the walkers' walk
count (int) Amount of time for the walkers to wander

result:
guy_path, jorn_path (list of PLines) Paths of wandering walkers
'''

"""
Create walkers and let them loose.
"""

# initialize the paths
guy_path = []
jorn_path = []

# for each walker:
for g in range(IN[3]):
    # create a random start point
    start_pt = Point.random(Interval(-2.0,2.0),constrain2d=True)
    # create a random initial velocity
    start_vel = Vec.random(normalize=True, constrain2d=True)
    
    # if this is an odd walker:
    if g%2 == 1 : 
        walker = IN[1][0](start_pt,start_vel) # make it a Jorn
    else : 
        walker = IN[0][0](start_pt,start_vel) # make it a Guy
        
    # for every time step:
    for s in range(IN[5]):
        # find vector nearest to the current position
        fvec = IN[2][0].vec_near(walker.pos)   
        # steer the walker
        walker.steer(fvec,IN[4])
        # update the walker's position
        walker.step()

    # if this walker is a Jorn:
    if isinstance(walker, IN[1][0]): 
        jorn_path.append(PLine(walker.hist)) # add path to Jorns
    else : 
        guy_path.append(PLine(walker.hist)) # add path to Guys



out.put(jorn_path)
#out.put(guy_path)


## -- BEGIN DECODES FOOTER -- ##
exec(io.dynamo_out.component_footer_code)
## -- END DECODES FOOTER -- ##
# ----------------------------------------
watch_3d_3 = Watch3D(decodes_script_8)
