# Dynamo graph 4.02.L04a.dyn (Dynamo 0.6.3.19437)

code_block = CodeBlock()
# ---------- code_block.designscript (28 lines) ----------
/*
A guy class is defined with a position, direction and a method for updating.
*/

class Guy
{
    Pos : Point;
    Vel : Vector;
    
    constructor FromPosVel(pos_start, vel_start)
    {
        // sets the initial position of the Guy
        Pos = pos_start;
        // sets the initial velocity vector for the Guy
        Vel = vel_start;
    }
    
    /*
    Cause the Guy object to move, using its current velocity, then randomly pick a new velocity
    */
    def Step : Guy()
    {
        // update the position of the Guy
        Pos = Point.ByCoordinates(Pos.X + Vel.X, Pos.Y + Vel.Y, Pos.Z + Vel.Z);
        // pick a new 2d velocity vector
        Vel = Vector.ByCoordinates(Math.Rand(-1, 1), Math.Rand(-1, 1), 0).Normalize;
    }
};
# ----------------------------------------
