# Dynamo graph 4.04.L01a.dyn (Dynamo 0.6.3.19437)

code_block = CodeBlock()
# ---------- code_block.designscript (6 lines) ----------
def color_point(r_val,g_val,b_val)
{
res = Point.ByCoordinates(r_val,g_val,b_val);

return = res;
};
# ----------------------------------------
number_slider = DoubleSliderInput(0.6974663052, range=0..1)
code_block_2 = CodeBlock(r=number_slider, g=number_slider, b=number_slider) { color_point(r,g,b); }
