# Dynamo graph 4.04.L03a.dyn (Dynamo 0.6.3.19437)

code_block = CodeBlock()
# ---------- code_block.designscript (27 lines) ----------
def diamond(t)
{
    c = Math.Cos((2 * Math.PI * t)*57.2957795);
    s = Math.Sin((2 * Math.PI * t)*57.2957795);
    pt_out = Point.ByCoordinates(len_x*Math.Abs(c)*c, len_y*Math.Abs(s)*s,0);
    return = pt_out;
}
     
def astroid(t)
{
    c = Math.Cos((2 * Math.PI * t)*57.2957795);
    s = Math.Sin((2 * Math.PI * t)*57.2957795);
    pt_out = Point.ByCoordinates(len_x * c * c * c, len_y * s * s * s,0);
    return = pt_out;
}

def func(t)
{
    t1 = (1 - m);
    x = diamond(t).X * t1 + astroid(t).X * m;
    y = diamond(t).Y * t1 + astroid(t).Y * m;
    return = Point.ByCoordinates(x, y, 0); 
};

len_x = 10.0;
len_y = 6.0;
m = 0.8;
# ----------------------------------------
code_block_2 = CodeBlock { tol = 0.01; crv_domain = 0..1..tol; Print(crv_domain); morph = BSplineCurve.ByPoints(func(crv_domain)); }
watch = Watch(code_block_2.morph)
